# Grasshopper definition CycleTrafficLocal.gh (Grasshopper 0.9.76)
# plug-ins: Firefly.X

panel = Panel("<directory-of-your-choice>\share\")
timer = Timer(TimerInterval=5000, Target=[c_script, concat])  # disabled
concat = Concatenate(FragmentA=panel, FragmentB="myPics_incoming/", FragmentC="pic.png")
load_bitmap = LoadBitmap(FilePathToImageLocation=concat)

# ----
# Save screenshot to file
panel_2 = Panel("myPics_outgoing\")

concat_2 = Concatenate(FragmentA=panel, FragmentB=panel_2)

c_script = CSharpScript(pathOut_L=concat_2, clearFolder=Button(), go=Toggle(False))  # -> file, fullName; inputs pathOut_L: String, clearFolder: Boolean, go: Boolean
# ---------- c_script: C# ----------
    RhinoDoc doc = RhinoDoc.ActiveDoc;

    if(pathOut_L != ""){
      if(!btJustPressed){
        var bitmap = doc.Views.ActiveView.CaptureToBitmap();
        //string fileName = TimeStamp() + ".png";
        string fileName = "pic.png";
        string filePath = pathOut_L + fileName;
        if(go)
          bitmap.Save(filePath);
        file = fileName;
        fullName = filePath;
      }
      if(clearFolder){
        System.IO.DirectoryInfo di = new DirectoryInfo(pathOut_L);

        foreach (FileInfo f in di.GetFiles())
        {
          f.Delete();
        }
        btJustPressed = true;
      }
      else
        btJustPressed = false;
    }
# ---------- c_script: C# additional code ----------
  bool btJustPressed = false;

  private string TimeStamp()
  {
    string str = AddZerosInFront(System.DateTime.Now.Year.ToString(), 4);
    str += AddZerosInFront(System.DateTime.Now.Month.ToString(), 2);
    str += AddZerosInFront(System.DateTime.Now.Day.ToString(), 2);
    str += AddZerosInFront(System.DateTime.Now.Hour.ToString(), 2);
    str += AddZerosInFront(System.DateTime.Now.Minute.ToString(), 2);
    str += AddZerosInFront(System.DateTime.Now.Second.ToString(), 2);
    str += AddZerosInFront(System.DateTime.Now.Millisecond.ToString(), 3);
    return str;
  }

  private string AddZerosInFront(string text, int targetLength)
  {
    for(int i = text.Length; i < targetLength; i++)
      text = "0" + text;
    return text;
  }
# ---------- end c_script ----------
